# Grasshopper definition ProjectAsPolygon.gh (Grasshopper 1.0.7)
# plug-ins: TwinLand

file_path = FilePath("C:\Users\carle\Desktop\temp\osmFile.osm")
importopenstreetmap = ImportOpenStreetMap(FilePath=file_path, OSMTag_KeyValue="natural=water", Clipped=False)  # -> Extends, Fields, Values, FeatureGeometry
unit_z = UnitZ(Factor=1)
brep = Brep(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)
project_as_polygon = ProjectAsPolygon(OSMFeatures=importopenstreetmap.FeatureGeometry, Geometry=brep, Direction=expr("-x", unit_z))
